# Grasshopper definition VisualizeGeoInRhino.gh (Grasshopper 1.0.7)
# plug-ins: Kangaroo2 Components

panel = Panel("""[[55.35, 19.0], [68.55, 28.25]]
[[52.05, 51.85], [68.55, 28.25]]
[[38.8, 42.6], [52.05, 51.85]]
[[28.5, 35.3], [45.0, 11.75]]
[[37.6, 6.6], [45.85, -5.25]]
[[45.85, -5.25], [63.6, 7.2]]
[[55.35, 19.0], [63.6, 7.2]]
[[12.85, 42.0], [30.55, 54.4]]
[[12.85, 42.0], [21.1, 30.15]]
[[30.55, 54.4], [38.8, 42.6]]
[[37.6, 6.6], [45.0, 11.8]]
[[45.0, 11.8], [55.35, 19.0]]
[[21.1, 30.15], [28.5, 35.35]]
[[28.5, 35.35], [38.8, 42.6]]""")
panel_2 = Panel(""",
[
]""")
split = TextSplit(Text=panel, Separators=panel_2)
num = Number(split)
clean = CleanTree(RemoveNulls=True, RemoveInvalid=True, RemoveEmpty=False, Tree=num)
item = ListItem(List=clean, Index=0, Wrap=True)  # -> Item, Item1, Item2, Item3
pt = ConstructPoint(XCoordinate=item.Item, YCoordinate=item.Item1, ZCoordinate=0)
pt_2 = ConstructPoint(XCoordinate=item.Item2, YCoordinate=item.Item3, ZCoordinate=0)
ln = Line(StartPoint=pt, EndPoint=pt_2)  # -> flatten(Line)
explode = Explode(Curve=ln, Recursive=True)  # -> Segments, flatten(Vertices)
item_2 = ListItem(List=ln, Index=Slider(3, range=0..100), Wrap=True)
duppt = RemoveDuplicatePts(Points=explode.Vertices, Tolerance=0.01)
item_3 = ListItem(List=duppt, Index=Slider(4, range=0..13), Wrap=True)
panel_3 = Panel(duppt)
